# Grasshopper definition ParserExample1.ghx (Grasshopper 1.0.8)
# plug-ins: ShapeDiverForGrasshopper
# Description

sddp = ShapeDiverDocumentPayload({AbsoluteTolerance=0, AngleTolerance=0, DistanceDisplayPrecision=0, GltfVersion="Gltf2", GrasshopperVersion="1.0.0008", InputGroups="{}", OutputGroups="{}", RelativeTolerance=0, RhinoVersion="8.17.25066.7001", UnitSystem=0, VersionCreated="1.24.1.0", VersionSaved="1.25.0.0"})
sphxy = Sphere(Base=PlaneXY(0, 0, 0), Radius=1)
meshxy = Mesh(sphxy)
gltfdisplay = GlTF20Display(Geometry=meshxy)
