# Grasshopper definition ParserExample2_VariableInputs_Rhino6.ghx (Grasshopper 1.0.7)
# plug-ins: ShapeDiverForGrasshopper

cone = Cone(Base=PlaneXY(0, 0, 0), Radius=0.5, Length=1)  # -> Cone, Tip
cyl = Cylinder(Base=PlaneXY(0, 0, 0), Radius=0.5, Length=1)
sphxy = Sphere(Base=PlaneXY(0, 0, 0), Radius=1)
merge = Merge(Data1=sphxy, Data2=cone.Cone, Data3=cyl)
gltfdisplay = GlTF20Display(Geometry=merge)
