# Grasshopper definition ParserExample3_CanvasGroup.ghx (Grasshopper 1.0.8)
# plug-ins: ShapeDiverForGrasshopper

sddp = ShapeDiverDocumentPayload({AbsoluteTolerance=0, AngleTolerance=0, DistanceDisplayPrecision=0, GltfVersion="Gltf2", GrasshopperVersion="1.0.0008", InputGroups="{}", OutputGroups="{}", RelativeTolerance=0, RhinoVersion="8.17.25066.7001", UnitSystem=0, VersionCreated="1.24.1.0", VersionSaved="1.25.0.0"})

num = Number(Slider(0.25, range=0..1))
cone = Cone(Base=PlaneXY(0, 0, 0), Radius=num, Length=1)  # -> Cone, Tip
cyl = Cylinder(Base=PlaneXY(0, 0, 0), Radius=num, Length=1)
sphxy = Sphere(Base=PlaneXY(0, 0, 0), Radius=num)
merge = Merge(Data1=sphxy, Data2=cone.Cone, Data3=cyl)

gltfdisplay = GlTF20Display(Geometry=merge)
