# Grasshopper definition ParserExample3_CanvasGroup_Rhino6.ghx (Grasshopper 1.0.7)
# plug-ins: ShapeDiverForGrasshopper

# ---- group: This is a group
num = Number(Slider(0.25, range=0..1))
cone = Cone(Base=PlaneXY(0, 0, 0), Radius=num, Length=1)  # -> Cone, Tip
cyl = Cylinder(Base=PlaneXY(0, 0, 0), Radius=num, Length=1)
sphxy = Sphere(Base=PlaneXY(0, 0, 0), Radius=num)
merge = Merge(Data1=sphxy, Data2=cone.Cone, Data3=cyl)

# ----
gltfdisplay = GlTF20Display(Geometry=merge)
