# Grasshopper definition ParserExample4_Cluster_Rhino7.ghx (Grasshopper 1.0.7)
# plug-ins: ShapeDiverForGrasshopper

cluster = Cluster(num=Slider(0.25, range=0..1))
gltfdisplay = GlTF20Display(Geometry=cluster)

# ==== cluster Cluster
num = ClusterInput()
num_2 = Number(num)
cone = Cone(Base=PlaneXY(0, 0, 0), Radius=num_2, Length=1)  # -> Cone, Tip
cyl = Cylinder(Base=PlaneXY(0, 0, 0), Radius=num_2, Length=1)
sphxy = Sphere(Base=PlaneXY(0, 0, 0), Radius=num_2)
merge = Merge(Data1=sphxy, Data2=cone.Cone, Data3=cyl)
R = ClusterOutput(merge)
