# Grasshopper definition ParserExample5_Modifiers.ghx (Grasshopper 1.0.8)
# plug-ins: ShapeDiverForGrasshopper

sddp = ShapeDiverDocumentPayload({AbsoluteTolerance=0, AngleTolerance=0, DistanceDisplayPrecision=0, GltfVersion="Gltf2", GrasshopperVersion="1.0.0008", InputGroups="{}", OutputGroups="{}", RelativeTolerance=0, RhinoVersion="8.18.25100.11001", UnitSystem=0, VersionCreated="1.24.1.0", VersionSaved="1.25.0.0"})
sphxy = Sphere(Base=PlaneXY(0, 0, 0), Radius=1)
meshxy_reverse = Mesh(reverse(sphxy))
meshxy2 = Mesh(flatten(meshxy_reverse))
meshxy2_2 = Mesh(graft(meshxy2))
meshxy2_3 = Mesh(simplify(meshxy2_2))
meshxy_preview = Mesh(meshxy2_3)
meshxy_disabled = Mesh(meshxy_preview)  # disabled
gltfdisplay = GlTF20Display(Geometry=graft(meshxy_disabled))
