# Grasshopper definition ParserExample5_Modifiers_Rhino6.ghx (Grasshopper 1.0.7)
# plug-ins: ShapeDiverForGrasshopper

sphxy = Sphere(Base=PlaneXY(0, 0, 0), Radius=1)
meshxy_reverse = Mesh(reverse(sphxy))
meshxy2 = Mesh(flatten(meshxy_reverse))
meshxy2_2 = Mesh(graft(meshxy2))
meshxy2_3 = Mesh(simplify(meshxy2_2))
meshxy_preview = Mesh(meshxy2_3)
meshxy_disabled = Mesh(meshxy_preview)  # disabled
gltfdisplay = GlTF20Display(Geometry=graft(meshxy_disabled))
