# Grasshopper definition ParserExample7_Rhino7Scripts.ghx (Grasshopper 1.0.7)

c_script = CSharpScript(Reference="C:\Program Files\ShapeDiver\ShapeDiverGhPlugins\Newtonsoft.Json.dll")  # -> out, A
# ---------- c_script: C# usings ----------
using System.Drawing;
# ---------- c_script: C# ----------
    A = x;
# ---------- c_script: C# additional code ----------
  private void DoSth()
  {
    
  }
# ---------- end c_script ----------
vb = VBScript(
    TooltipDescriptionOverride="Tooltip description",
    TooltipTextOverride="Tooltip text",
    Reference="C:\Program Files\ShapeDiver\ShapeDiverGhPlugins\Newtonsoft.Json.dll")  # -> out, A
# ---------- vb: VB usings ----------
Imports System.Drawing
# ---------- vb: VB ----------
    A = x
# ---------- vb: VB additional code ----------
  Private Sub NoSuchFunction()
   
  End Sub
# ---------- end vb ----------
python = GhPythonScript()  # -> out, a
# ---------- python: Python ----------
__author__ = "axl"
__version__ = "2026.03.14"

import rhinoscriptsyntax as rs

a = x
# ---------- end python ----------
