# Grasshopper definition ParserExample7_Rhino8Scripts.ghx (Grasshopper 1.0.8)

py3 = Python3Script()  # -> out, a
# ---------- py3: Python ----------
"""Grasshopper Script"""
a = "Hello! Python 3 in Grasshopper!"
print(a)
# ---------- end py3 ----------
c_script = CSharpScript()  # -> out, a
# ---------- c_script: C# ----------
// Grasshopper Script Instance
#region Usings
using System;
using System.Linq;
using System.Collections;
using System.Collections.Generic;
using System.Drawing;

using Rhino;
using Rhino.Geometry;

using Grasshopper;
using Grasshopper.Kernel;
using Grasshopper.Kernel.Data;
using Grasshopper.Kernel.Types;
using System.Drawing;
#r "nuget: NPOI"
#endregion


public class Script_Instance : GH_ScriptInstance
{
    #region Notes
    /* 
      Members:
        RhinoDoc RhinoDocument
        GH_Document GrasshopperDocument
        IGH_Component Component
        int Iteration

      Methods (Virtual & overridable):
        Print(string text)
        Print(string format, params object[] args)
        Reflect(object obj)
        Reflect(object obj, string method_name)
    */
    #endregion

    private void RunScript(object x, object y, ref object a)
    {
        // Write your logic here
        a = x;
    }
}

public class MyClass
{
    
}
# ---------- end c_script ----------
ipy2 = IronPython2Script()  # -> out, a
# ---------- ipy2: IronPython ----------
"""Grasshopper Script"""
a = "Hello! IronPython 2 in Grasshopper!"
print(a)
# ---------- end ipy2 ----------
vb = VBScript()  # -> out, A
# ---------- vb: C# ----------
    A = x
# ---------- end vb ----------
